# Dynamo graph AllNodes.dyn (Dynamo 1.3.1.1736)

# group: INPUT
file_path = Filename("..\..\..\Desktop\journals\Journals_dhess\journal.0240.txt.copy.txt")

# group: Journal.Create
fromPath = FileObject(file_path)  # "File.FromPath"
readText = File.ReadText(fromPath)
# note: QUESTION:
# Does the graph execute okay? Do any nodes turn yellow?
byString = Custom[Journal.ByString](str=readText)

# group: JournalMiscCommand TEST
string = StringInput("JournalMiscCommand")  # frozen
getLinesByType = Custom[Journal.GetLinesByType](journal=byString, journalLineType=string)
rawText = Custom[JournalLine.RawText](journalLine=getLinesByType)
watch = Watch(rawText)
string_2 = StringInput(" ")
split = String.Split(rawText, string_2)
transpose = List.Transpose(split)
firstItem = List.FirstItem(transpose)
groupByKey = List.GroupByKey(list=rawText, keys=firstItem)
# note: QUESTION:
# Do you see more than three items in this list? (Dim, Set, Jrn.Size)
watch_2 = Watch(groupByKey.unique_keys)
watch_3 = Watch(groupByKey.groups)

# group: Journal.Query
user = Custom[Journal.User](journal=byString)
lineCount = Custom[Journal.LineCount](journal=byString)
blockCount = Custom[Journal.BlockCount](journal=byString)
lines = Custom[Journal.Lines](journal=byString)
path = Custom[Journal.Path](journal=byString)
processingTime = Custom[Journal.ProcessingTime](journal=byString)
sessionTime = Custom[Journal.SessionTime](journal=byString)
startupTime = Custom[Journal.StartupTime](journal=byString)
loadedAssemblies = Custom[Journal.LoadedAssemblies](journal=byString)
loadedModels = Custom[Journal.LoadedModels](journal=byString)
sessionTerminatedProperly = Custom[Journal.SessionTerminatedProperly](journal=byString)
isInPlaybackMode = Custom[Journal.IsInPlaybackMode](journal=byString)
playbackInterrupted = Custom[Journal.PlaybackInterrupted](journal=byString)
revitBuild = Custom[Journal.RevitBuild](journal=byString)
revitBranch = Custom[Journal.RevitBranch](journal=byString)
revitVersion = Custom[Journal.RevitVersion](journal=byString)
OSVersion = Custom[Journal.OSVersion](journal=byString)
containsAPIErrors = Custom[Journal.ContainsAPIErrors](journal=byString)
containsExceptions = Custom[Journal.ContainsExceptions](journal=byString)
machine = Custom[Journal.Machine](journal=byString)

# group: Test Inputs
code_block = CodeBlock { {"JournalData","JournalDirective"}; "JournalData"; }
code_block_2 = CodeBlock { 30..34; 33; }

# group: Journal.Actions
getLinesByType_2 = Custom[Journal.GetLinesByType](journal=byString, journalLineType=code_block.out0)
getLinesByBlock = Custom[Journal.GetLinesByBlock](journal=byString, journalBlock=code_block_2.out0)

# group: JournalLine.Query
number = Custom[JournalLine.Number](journalLine=lines)
type = Custom[JournalLine.Type](journalLine=lines)
block = Custom[JournalLine.Block](journalLine=lines)
rawText_2 = Custom[JournalLine.RawText](journalLine=lines)

# group: JournalComment TEST
string_3 = StringInput("JournalComment")
getLinesByType_3 = Custom[Journal.GetLinesByType](journal=byString, journalLineType=string_3)
rawText_3 = Custom[JournalLine.RawText](journalLine=getLinesByType_3)
string_4 = StringInput(" ")
split_2 = String.Split(rawText_3, string_4)
transpose_2 = List.Transpose(split_2)
firstItem_2 = List.FirstItem(transpose_2)
groupByKey_2 = List.GroupByKey(list=rawText_3, keys=firstItem_2)
# note: QUESTION:
# Would you like to be able to pull any of this data from the journal file?
watch_4 = Watch(groupByKey_2.unique_keys)
watch_5 = Watch(groupByKey_2.groups)
watch_6 = Watch(rawText_3)

# group: JournalLineTypes
all = Custom[JournalLineTypes.All]()
watch_7 = Watch(all)

# group: Python Examples
# note: Extract unique list of API error messages
python_script = Python(IN[0]=byString)
# ---------- python_script.python (6 lines) ----------
import clr

OUT = []
if IN[0].__repr__() == 'Journal':
	allAPImsgs = IN[0].GetLinesByType('JournalAPIMessage')
	OUT = set([x.MessageText for x in allAPImsgs if x.MessageType == 'Error'])
# ----------------------------------------
watch_8 = Watch(python_script)
# note: Extract unique list of commands triggered by a keyboard shortcut
python_script_2 = Python(IN[0]=byString)
# ---------- python_script_2.python (6 lines) ----------
import clr

OUT = []
if IN[0].__repr__() == 'Journal':
	allJCommands = IN[0].GetLinesByType('JournalCommand')
	OUT = set([x.CommandID for x in allJCommands if x.CommandType == 'KeyboardShortcut'])
# ----------------------------------------
watch_9 = Watch(python_script_2)
# note: When was a model closed during the session?
python_script_3 = Python(IN[0]=byString)
# ---------- python_script_3.python (12 lines) ----------
import clr

OUT = []
files = []
ts = []
if IN[0].__repr__() == 'Journal':
	allUIEvents = IN[0].GetLinesByType('JournalUIEvent')
	closingEvents = [x for x in allUIEvents if x.UIEventType == 'Close']
	for event in closingEvents:
		files.append(event.Data[0][1:-1])
		ts.append(IN[0].GetLinesByBlock(event.Block)[0].DateTime)
OUT = (files,ts)
# ----------------------------------------
watch_10 = Watch(python_script_3)

# group: JournalAPIMessage.Query
string_5 = StringInput("JournalAPIMessage")
getLinesByType_4 = Custom[Journal.GetLinesByType](journal=byString, journalLineType=string_5)
text = Custom[JournalAPIMessage.Text](journalAPIMessage=getLinesByType_4)
type_2 = Custom[JournalAPIMessage.Type](journalAPIMessage=getLinesByType_4)

# group: JournalCommand.Query
string_6 = StringInput("JournalCommand")
getLinesByType_5 = Custom[Journal.GetLinesByType](journal=byString, journalLineType=string_6)
type_3 = Custom[JournalCommand.Type](journalCommand=getLinesByType_5)
description = Custom[JournalCommand.Description](journalCommand=getLinesByType_5)
ID = Custom[JournalCommand.ID](journalCommand=getLinesByType_5)

# group: JournalAddinEvent.Query
string_7 = StringInput("JournalAddinEvent")
getLinesByType_6 = Custom[Journal.GetLinesByType](journal=byString, journalLineType=string_7)
text_2 = Custom[JournalAddinEvent.Text](journalAddinEvent=getLinesByType_6)

# group: JournalData.Query
string_8 = StringInput("JournalData")
getLinesByType_7 = Custom[Journal.GetLinesByType](journal=byString, journalLineType=string_8)
key = Custom[JournalData.Key](journalData=getLinesByType_7)
values = Custom[JournalData.Values](journalData=getLinesByType_7)

# group: JournalDirective.Query
string_9 = StringInput("JournalDirective")
getLinesByType_8 = Custom[Journal.GetLinesByType](journal=byString, journalLineType=string_9)
key_2 = Custom[JournalDirective.Key](journalDirective=getLinesByType_8)
values_2 = Custom[JournalDirective.Values](journalDirective=getLinesByType_8)

# group: JournalGUIResourceUsage.Query
string_10 = StringInput("JournalGUIResourceUsage")
getLinesByType_9 = Custom[Journal.GetLinesByType](journal=byString, journalLineType=string_10)
available = Custom[JournalGUIResourceUsage.Available](journalGUIResourceUsage=getLinesByType_9)
used = Custom[JournalGUIResourceUsage.Used](journalGUIResourceUsage=getLinesByType_9)
user_2 = Custom[JournalGUIResourceUsage.User](journalGUIResourceUsage=getLinesByType_9)

# group: JournalKeyboardEvent.Query
string_11 = StringInput("JournalKeyboardEvent")
getLinesByType_10 = Custom[Journal.GetLinesByType](journal=byString, journalLineType=string_11)
key_3 = Custom[JournalKeyboardEvent.Key](journalKeyboardEvent=getLinesByType_10)

# group: JournalMemoryMetrics.Query
string_12 = StringInput("JournalMemoryMetrics")
getLinesByType_11 = Custom[Journal.GetLinesByType](journal=byString, journalLineType=string_12)
VMAvailable = Custom[JournalMemoryMetrics.VMAvailable](journalMemoryMetrics=getLinesByType_11)
VMUsed = Custom[JournalMemoryMetrics.VMUsed](journalMemoryMetrics=getLinesByType_11)
VMPeak = Custom[JournalMemoryMetrics.VMPeak](journalMemoryMetrics=getLinesByType_11)
RAMAvailable = Custom[JournalMemoryMetrics.RAMAvailable](journalMemoryMetrics=getLinesByType_11)
RAMUsed = Custom[JournalMemoryMetrics.RAMUsed](journalMemoryMetrics=getLinesByType_11)
RAMPeak = Custom[JournalMemoryMetrics.RAMPeak](journalMemoryMetrics=getLinesByType_11)

# group: JournalMouseEvent.Query
string_13 = StringInput("JournalMouseEvent")
getLinesByType_12 = Custom[Journal.GetLinesByType](journal=byString, journalLineType=string_13)
type_4 = Custom[JournalMouseEvent.Type](journalMouseEvent=getLinesByType_12)
data = Custom[JournalMouseEvent.Data](journalMouseEvent=getLinesByType_12)

# group: JournalTimeStamp.Query
string_14 = StringInput("JournalTimeStamp")
getLinesByType_13 = Custom[Journal.GetLinesByType](journal=byString, journalLineType=string_14)
type_5 = Custom[JournalTimeStamp.Type](journalTimeStamp=getLinesByType_13)
dateTime = Custom[JournalTimeStamp.DateTime](journalTimeStamp=getLinesByType_13)
description_2 = Custom[JournalTimeStamp.Description](journalTimeStamp=getLinesByType_13)

# group: JournalUIEvent.Query
string_15 = StringInput("JournalUIEvent")
getLinesByType_14 = Custom[Journal.GetLinesByType](journal=byString, journalLineType=string_15)
type_6 = Custom[JournalUIEvent.Type](journalUIEvent=getLinesByType_14)
data_2 = Custom[JournalUIEvent.Data](journalUIEvent=getLinesByType_14)

# group: Journal Members
members = Custom[Object.Members](element=byString)  # Gets a list of all members (properties and methods) of a selected element
watch_11 = Watch(members)
